# Dynamo graph Conduit_Length_Checker.dyn (Dynamo 2.6.2.15705)
# packages: Genius Loci 2022.1.5

color_palette = ColorPalette({R: 255, G: 0, B: 0, A: 255})
overrideColorInView = Element.OverrideColorInView()  # unwired: element, color
categories = Categories("OST_Conduit")
all_elements_of_category = ElementsOfCategory(Category=categories)
string = StringInput("Length")
getParameterValueByName = Element.GetParameterValueByName(element=all_elements_of_category, parameterName=string)
round = Math.Round(number=getParameterValueByName)
code_block = CodeBlock { 3000; }
gt = round > code_block
filterByBoolMask = List.FilterByBoolMask(list=all_elements_of_category, mask=gt)
show_element = Custom[Show Element](element=filterByBoolMask.in)  # package Genius Loci; Shows the given elements by zoom to fit in a view and select them.
